# Grasshopper definition Corazon1.gh (Grasshopper 1.0.7)

neg = Negative(Value=Slider(0, range=0..720))
pt = Point(Point(0, 0, 0))
subtraction = Subtraction(A=neg, B="90")
Y = UnitY(Factor=[Slider(1, range=0..10), Slider(3.6, range=0..10)])
item = ListItem(List=[Slider(1.1, range=0..10), Slider(2.2, range=0..10), Slider(5.5, range=0..10)], Index=0, Wrap=True)  # -> Item, Item1, Item2
pt_2 = PointPolar(BasePlane=pt, XYAngle=degrees(subtraction), ZAngle=0, Offset=item.Item)
move = Move(Geometry=pt, Motion=Y)  # -> Geometry, Transform
ln = Line(StartPoint=pt, EndPoint=pt_2)
item_2 = ListItem(List=move.Geometry, Index=0, Wrap=True)  # -> Item, Item1
end = EndPoints(Curve=ln)  # -> Start, End
vec2pt = Vector2Pt(PointA=end.End, PointB=item_2.Item, Unitize=False)  # -> Vector, Length
line = LineSDL(Start=end.End, Direction=vec2pt.Vector, Length=item.Item1)
end_2 = EndPoints(Curve=line)  # -> Start, End
vec2pt_2 = Vector2Pt(PointA=end_2.End, PointB=item_2.Item1, Unitize=False)  # -> Vector, Length
line_2 = LineSDL(Start=end_2.End, Direction=vec2pt_2.Vector, Length=item.Item2)
end_3 = EndPoints(Curve=line_2)  # -> Start, End
cir = Circle(Plane=[pt, move.Geometry, end_3.End], Radius="0.05")
rec = DataRecorder(end_3.End, DataLimit=-10, RecordData=True)
