# Grasshopper definition PD2021-1 BasicStructure1.gh (Grasshopper 1.0.7)

pt = Point(Point(0, 0, 0))
pt_2 = Point(Point(0, 0, 11.60974605))
cir = Circle(Plane=pt, Radius=Slider(10, range=0..10))
number_slider = Slider(33, range=0..100)
cir_2 = Circle(Plane=pt_2, Radius=Slider(4.2, range=0..10))
divide = DivideCurve(Curve=cir, Count=number_slider, Kinks=False)  # -> Points, Tangents, Parameters
divide_2 = DivideCurve(Curve=cir_2, Count=number_slider, Kinks=False)  # -> Points, Tangents, Parameters
shift = ShiftList(List=divide.Points, Shift=1, Wrap=True)
shift_2 = ShiftList(List=divide_2.Points, Shift=1, Wrap=True)
ln = Line(StartPoint=shift, EndPoint=divide_2.Points)
ln_2 = Line(StartPoint=divide.Points, EndPoint=shift_2)
pipe = Pipe(Curve=[ln, ln_2], Radius=Slider(0.13, range=0..1), Caps=0)
