# Grasshopper definition PD2021-1 BasicTensil&Inflated1.gh (Grasshopper 1.0.7)
# plug-ins: Kangaroo2 Components

brep = Brep(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)
mesh = MeshBrep(
    Brep=brep,
    Settings={GridMaxCount=0, GridMinCount=16, JaggedSeams=False, MaxEdgeLength=0, MinEdgeLength=0.0001, MinTolerance=0, Refine=True, RefineAngle=0, RelativeTolerance=0.65, SimplePlanes=True, Tolerance=0})
debrep = DeconstructBrep(Brep=brep)  # -> Faces, Edges, Vertices
refine = Refine(Mesh=mesh, Level=Slider(4, range=0..10))
edgelengths = EdgeLengths(Mesh=refine, LengthFactor="0", Strength=Slider(10, range=0..10))
anchor = Anchor(Point=debrep.Vertices, Strength=10000)
pressure = Pressure(M=refine, Strength=Slider(2.07, range=0..10))
show = Show(G=refine)
on = BooleanToggle(True)
reset = Button()
merge = Merge(Data1=show, Data2=edgelengths, Data3=pressure, Data4=anchor)
solver = Solver(GoalObjects=merge, Reset=reset, Threshold=1e-15, Tolerance=0.0001, On=on)  # -> I, V, flatten(O)
item = ListItem(List=solver.O, Index=0, Wrap=True)
preview = CustomPreview(
    Geometry=item,
    Material={diffuse=RGB(221, 160, 221), emission=RGB(66, 48, 66), shine=0.5, specular=RGB(255, 255, 255), transparency=0})
