# Grasshopper definition PD2021-1 BasicTensil1.gh (Grasshopper 1.0.7)
# plug-ins: MeshEdit Components, Kangaroo2 Components, Weaverbird

crv = Curve(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)
patch = Patch(Curves=crv, Spans=20, Flexibility=1, Trim=True)
mesh = Mesh(patch)
triangulate = MeshTriangulate(Mesh=mesh, ShortDiagonal=True)
triremesh = TriRemesh(Geometry=triangulate, Length=Slider(5, range=0..10), Iterations=25)  # -> Triangulation, Dual, Creases
medges = MeshEdges(Mesh=triremesh.Triangulation)  # -> NakedEdges, InteriorEdges, NonManifoldEdges
panel = Panel("""544
517
395""")
nv = NakedVertices(Mesh=triremesh.Triangulation)  # -> ClothedIndex, NakedIndex, ClothedPts, NakedPts
show = Show(G=triremesh.Triangulation)
ls = LiveSoap(Mesh=triremesh.Triangulation, UseVolume=False, VolumeChange=0, Strength=1, Reset=False)
length_line = LengthLine(Line=[medges.NakedEdges, medges.InteriorEdges], Length="0", Strength=Slider(100, range=0..100))
item = ListItem(List=nv.ClothedPts, Index=panel, Wrap=True)
points = PointList(Points=nv.ClothedPts)
Z = UnitZ(Factor=Slider(54.83, range=0..100))
pt = Point(nv.NakedPts)
move = Move(Geometry=item, Motion=Z)  # -> Geometry, Transform
anchor = Anchor(Point=pt, Strength=10000)
anchor_2 = Anchor(Point=item, Target=move.Geometry, Strength=10000)
merge = Merge(Data1=show, Data2=ls, Data3=anchor, Data4=anchor_2, Data6=length_line)
solver = Solver(GoalObjects=merge, Reset=Button(), Threshold=1e-15, Tolerance=0.0001, On=Toggle(True))  # -> I, V, flatten(O)
item_2 = ListItem(List=solver.O, Index=0, Wrap=True)
wbloop = WeaverbirdsLoopSubdivision(MeshCurves=item_2, Level="1", SmoothNakedEdges="0")
preview = CustomPreview(
    Geometry=wbloop,
    Material={diffuse=RGB(221, 160, 221), emission=RGB(66, 48, 66), shine=0.5, specular=RGB(255, 255, 255), transparency=0})
