# Grasshopper definition PD2021-1 BasicTensil4.gh (Grasshopper 1.0.7)
# plug-ins: Kangaroo2 Components, Kangaroo Components, Human

crv = Curve([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])
crv_2 = Curve([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])
number_slider = Slider(0.05, range=0..1)
number_slider_2 = Slider(0.35, range=0..1)
number_slider_3 = Slider(0.24, range=0..1)
number_slider_4 = Slider(0.28, range=0..1)
loft = Loft(Curves=crv_2, Options={Adjust=False, Closed=False, LoftEnds=0, LoftSimp=0, LoftType=0, Rebuild=10, Refit=0.01})
previewlw = CustomPreviewLineweights(Geometry=crv_2, Shader=ColourSwatch(SwatchColor=RGB(0, 0, 0)), Thickness=5, Absolute=False)
crv_3 = Curve(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)
crv_4 = Curve(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)
cull_i = CullIndex(List=crv, Indices="0", Wrap=True)
cull_i_2 = CullIndex(List=crv, Indices="-1", Wrap=True)
addition = Addition(A=number_slider_2, B=number_slider)
addition_2 = Addition(A=number_slider_4, B=number_slider_3)
mesh_uv = MeshSurface(Surface=loft, UCount=Slider(20, range=0..100), VCount=Slider(20, range=0..100), Overhang=True, Equalize=False)
addition_3 = Addition(A=addition, B=number_slider)
weave = Weave(Pattern=[0, 1], Stream0=cull_i_2, Stream1=cull_i, NullGaps=False)
addition_4 = Addition(A=addition_2, B=number_slider_3)
panel = Panel("""0
4
12
20
59
62
72
79""")
eval = EvaluateCurve(Curve=reparameterize(crv_3), Parameter=number_slider_2)  # -> Point, Tangent, Angle
nv = NakedVertices(Mesh=mesh_uv)  # -> ClothedIndex, NakedIndex, ClothedPts, NakedPts
pframe = PerpFrame(Curve=reparameterize(crv_4), Parameter=number_slider_4)
eval_2 = EvaluateCurve(Curve=reparameterize(crv_3), Parameter=addition)  # -> Point, Tangent, Angle
partition = PartitionList(List=weave, Size="2")
eval_3 = EvaluateCurve(Curve=reparameterize(crv_3), Parameter=addition_3)  # -> Point, Tangent, Angle
pframe_2 = PerpFrame(Curve=reparameterize(crv_4), Parameter=addition_2)
loft_2 = Loft(Curves=partition, Options={Adjust=False, Closed=False, LoftEnds=0, LoftSimp=0, LoftType=0, Rebuild=10, Refit=0.01})  # -> simplify(flatten(Loft))
pframe_3 = PerpFrame(Curve=reparameterize(crv_4), Parameter=addition_4)
item = ListItem(List=nv.NakedPts, Index=panel, Wrap=True)
arc = Arc(Plane=pframe, Radius=Slider(50, range=0..100), Angle=Domain(0, 3.141592654))  # -> Arc, Length
arc_2 = Arc(Plane=pframe_2, Radius=Slider(50, range=0..100), Angle=Domain(0, 3.141592654))  # -> Arc, Length
arc_3 = Arc(Plane=pframe_3, Radius=Slider(50, range=0..100), Angle=Domain(0, 3.141592654))  # -> Arc, Length
previewlw_2 = CustomPreviewLineweights(Geometry=crv, Shader=ColourSwatch(SwatchColor=RGB(0, 0, 0)), Thickness=5, Absolute=False)
anchor = Anchor(Point=item, Strength=10000)
length_line = LengthLine(Strength=10)
edgelengths = EdgeLengths(Mesh=mesh_uv, LengthFactor="0", Strength=1)
show = Show(G=mesh_uv)
mesh_uv_2 = MeshSurface(Surface=loft_2, UCount=Slider(20, range=0..100), VCount=Slider(20, range=0..100), Overhang=True, Equalize=False)
item_2 = ListItem(List=mesh_uv_2, Index=Slider(0, range=0..10), Wrap=True)
nv_2 = NakedVertices(Mesh=item_2)  # -> ClothedIndex, NakedIndex, ClothedPts, NakedPts
merge = Merge(Data1=show, Data2=edgelengths, Data3=anchor)
points = PointList(Points=nv_2.NakedPts, Size=Slider(3.35, range=0..10))
bouncysolver = BouncySolver(GoalObjects=merge, Reset=Button(), Threshold=1e-15, Tolerance=0.0001, Damping=0.99, Iterations=10, On=Toggle(False))  # -> I, V, O
nv_3 = NakedVertices(Mesh=mesh_uv_2)  # -> ClothedIndex, NakedIndex, ClothedPts, NakedPts
panel_2 = Panel("""0
4
12
20
59
62
72
79""")
item_3 = ListItem(List=bouncysolver.O, Index=0, Wrap=True)
item_4 = ListItem(List=nv_3.NakedPts, Index=panel_2, Wrap=True)
panel_3 = Panel(bouncysolver.O)
anchor_2 = Anchor(Point=item_4, Strength=10000)
length_line_2 = LengthLine(Strength=10)
edgelengths_2 = EdgeLengths(Mesh=mesh_uv_2, LengthFactor="0", Strength=1)
show_2 = Show(G=mesh_uv_2)
merge_2 = Merge(Data1=show_2, Data2=edgelengths_2, Data3=anchor_2)
bouncysolver_2 = BouncySolver(GoalObjects=merge_2, Reset=Button(), Threshold=1e-15, Tolerance=0.0001, Damping=0.99, Iterations=10, On=Toggle(True))  # -> I, V, O
panel_4 = Panel("""0
1
2
3""")
item_5 = ListItem(List=bouncysolver_2.O, Index=panel_4, Wrap=True)
panel_5 = Panel(bouncysolver_2.O)
