# Grasshopper definition PD2021-BasicTensil3.gh (Grasshopper 1.0.7)
# plug-ins: Weaverbird, Kangaroo2 Components, Kangaroo Components, MeshEdit Components

pt_base = Point([Point(-10, 17.32050808, 5.57657481), Point(10, 17.32050808, 0), Point(20, 0, 0), Point(10, -17.32050808, 0), Point(-10, -17.32050808, 0), Point(-20, 0, 0)])
pt_int = Point([Point(-6.543655702, 8.928600526, 15.91525783), Point(11.11285806, 4.306148375, 13.80190309), Point(-0.4129217566, -7.137888322, 9.585215382)])
polygon = Polygon(Plane=PlaneXY(0, 0, 0), Radius=Slider(20, range=0..100), Segments=Slider(10, range=0..10), FilletRadius=0)  # -> Polygon, Length
area = Area(Geometry=polygon.Polygon)  # -> Area, Centroid
wbdodecahedron = WeaverbirdsPolylinesDodecahedron(Plane=PlaneXY(0, 0, 0), Radius=5)
merge = Merge(Data1=pt_base, Data2=pt_int)
del = DelaunayMesh(Points=merge, Plane=PlaneXY(0, 0, 0))
explode = Explode(Curve=wbdodecahedron, Recursive=True)  # -> flatten(Segments), Vertices
scale = Scale(Geometry=polygon.Polygon, Center=area.Centroid, Factor=Slider(0.21, range=0..1))  # -> Geometry, Transform
merge_2 = Merge(Data1=polygon.Polygon, Data2=scale.Geometry)
refine = Refine(Mesh=del, Level=Slider(4, range=0..10))
loft = Loft(Curves=merge_2, Options={Adjust=False, Closed=False, LoftEnds=0, LoftSimp=0, LoftType=0, Rebuild=10, Refit=0.01})
crv = Curve(explode.Segments)
mesh = Mesh(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)
dupln = RemoveDuplicateLines(Lines=crv, Tolerance=0.01)
smesh = SimpleMesh(Brep=loft)
demesh = DeconstructMesh(Mesh=refine)  # -> Vertices, Faces, Colours, Normals
weldvertices = MeshWeldVertices(Mesh=smesh, Tolerance=0.01)  # -> RuntimeMessage, Mesh
edgelengths = EdgeLengths(Mesh=refine, LengthFactor="0", Strength=1)
cp = ClosestPoint(Point=merge, Cloud=demesh.Vertices)  # -> ClosestPoint, CPIndex, Distance
mp = MultiPipe(Curves=dupln, NodeSize=Slider(0.25, range=0..1), EndOffset=1, StrutSize=1, Segment=0, KinkAngle=0.6, CubeFit=0, Caps=0)
show = Show(G=refine)
wbcatmullclark = WeaverbirdsCatmullClarkSubdivision(MeshCurves=mesh, Level=Slider(2, range=0..10), SmoothNakedEdges=0)
weld = WeldMesh(Mesh=weldvertices.Mesh, Angle=3.141592654)
demesh_2 = DeconstructMesh(Mesh=wbcatmullclark)  # -> Vertices, Faces, Colours, Normals
mc = MeshCorners(Mesh=wbcatmullclark, Angle=2.35619449)
item = ListItem(List=demesh.Vertices, Index=cp.CPIndex, Wrap=True)
nv = NakedVertices(Mesh=wbcatmullclark)  # -> ClothedIndex, NakedIndex, ClothedPts, NakedPts
preview = CustomPreview(
    Geometry=mp,
    Material={diffuse=RGB(221, 160, 221), emission=RGB(66, 48, 66), shine=0.5, specular=RGB(255, 255, 255), transparency=0})
medges = MeshEdges(Mesh=wbcatmullclark)  # -> NakedEdges, InteriorEdges, NonManifoldEdges
anchor = Anchor(Point=item, Strength=10000)
merge_3 = Merge(Data1=show, Data2=edgelengths, Data3=anchor)
panel = Panel("""0
1
2
3""")
wbcatmullclark_2 = WeaverbirdsCatmullClarkSubdivision(MeshCurves=weld, Level=Slider(2, range=0..10), SmoothNakedEdges=0)
panel_2 = Panel("""70
68
66
64
63
60
78
76
74
72""")
points = PointList(Points=mc, Size=Slider(1.25, range=0..10))
demesh_3 = DeconstructMesh(Mesh=wbcatmullclark_2)  # -> Vertices, Faces, Colours, Normals
join = JoinCurves(Curves=medges.NakedEdges, Preserve=False)
nv_2 = NakedVertices(Mesh=wbcatmullclark_2)  # -> ClothedIndex, NakedIndex, ClothedPts, NakedPts
item_2 = ListItem(List=mc, Index=panel, Wrap=True)
medges_2 = MeshEdges(Mesh=wbcatmullclark_2)  # -> NakedEdges, InteriorEdges, NonManifoldEdges
pt = Point(nv.NakedPts)
item_3 = ListItem(List=join, Index="1", Wrap=True)
crv_2 = Curve(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)
points_2 = PointList(Points=nv_2.NakedPts, Size=1.25)
join_2 = JoinCurves(Curves=medges_2.NakedEdges, Preserve=False)
bouncysolver = BouncySolver(GoalObjects=merge_3, Reset=Button(), Threshold=1e-15, Tolerance=0.0001, Damping=0.99, Iterations=10, On=Toggle(False))  # -> I, V, O
crv_cp = CurveClosestPoint(Point=nv.NakedPts, Curve=item_3)  # -> Point, Parameter, Distance
anchor_2 = Anchor(Point=item_2, Strength=10000)
item_4 = ListItem(List=nv_2.NakedPts, Index=panel_2, Wrap=True)
pt_2 = Point(nv_2.NakedPts)
equals = Equality(FirstNumber=crv_cp.Distance, SecondNumber=0)  # -> Equality, Inequality
item_5 = ListItem(List=join_2, Index="1", Wrap=True)
crv_3 = Curve(<curve referenced from the Rhino model>)
number_slider = Slider(10, range=0..10)
edgelengths_2 = EdgeLengths(Mesh=wbcatmullclark, LengthFactor="0", Strength=1)
cull = CullPattern(List=pt, CullPattern=equals.Equality)
item_6 = ListItem(List=bouncysolver.O, Index=0, Wrap=True)
crv_cp_2 = CurveClosestPoint(Point=nv_2.NakedPts, Curve=item_5)  # -> Point, Parameter, Distance
anchor_3 = Anchor(Point=item_4, Strength=10000)
show_2 = Show(G=wbcatmullclark)
oncurve = OnCurve(Points=cull, Curve=crv_2, Strength=Slider(10000, range=0..10000))
equals_2 = Equality(FirstNumber=crv_cp_2.Distance, SecondNumber=0)  # -> Equality, Inequality
edgelengths_3 = EdgeLengths(Mesh=wbcatmullclark_2, LengthFactor="0", Strength=Slider(1000, range=0..1000))
cull_2 = CullPattern(List=pt_2, CullPattern=equals_2.Equality)
merge_4 = Merge(Data1=show_2, Data2=edgelengths_2, Data3=anchor_2, Data4=oncurve)
show_3 = Show(G=wbcatmullclark_2)
oncurve_2 = OnCurve(Points=cull_2, Curve=crv_3, Strength=Slider(10000, range=0..10000))
bouncysolver_2 = BouncySolver(GoalObjects=merge_4, Reset=Button(), Threshold=1e-15, Tolerance=0.0001, Damping=0.99, Iterations=10, On=Toggle(False))  # -> I, V, O
merge_5 = Merge(Data1=show_3, Data2=edgelengths_3, Data3=anchor_3, Data4=oncurve_2)
bouncysolver_3 = BouncySolver(GoalObjects=merge_5, Reset=Button(), Threshold=1e-15, Tolerance=0.0001, Damping=0.99, Iterations=10, On=Toggle(True))  # -> I, V, O
panel_3 = Panel(bouncysolver_2.O)
item_7 = ListItem(List=bouncysolver_2.O, Index=0, Wrap=True)
panel_4 = Panel(bouncysolver_3.O)
item_8 = ListItem(List=bouncysolver_3.O, Index=0, Wrap=True)
