# Grasshopper definition Variacion.gh (Grasshopper 1.0.7)

trigger = Trigger(Interval=10, TimerInterval=10, Target=num)  # disabled
num = Number(0)
r = Slider(0.7, range=0..10)
Z = UnitZ(Factor=r)
addition = Addition(A=num, B="0.01")
expression = Expression(r=r, Expression="2*r*π")
rec = DataRecorder(addition, DataLimit=-10, RecordData=True)
pt = Point(Point(0, 0, 0))
multiplication = Multiplication(A=expression, B=Slider(3, range=0..10))
X = UnitX(Factor=1)
ma = MassAddition(Input=rec)  # -> Result, PartialResults
line = LineSDL(Start=pt, Direction=X, Length=multiplication)
panel = Panel("""0.25
0.75""")
eval = EvaluateCurve(Curve=reparameterize(line), Parameter=ma.Result)  # -> Point, Tangent, Angle
move = Move(Geometry=eval.Point, Motion=Z)  # -> Geometry, Transform
xz = XZPlane(Origin=move.Geometry)
cir = Circle(Plane=xz, Radius=r)
boundary = BoundarySurfaces(Edges=cir)
eval_2 = EvaluateCurve(Curve=reparameterize(cir), Parameter=panel)  # -> Point, Tangent, Angle
multiplication_2 = Multiplication(A=ma.Result, B="360")
item = ListItem(List=eval_2.Point, Index="0", Wrap=True)  # -> Item, Item1
neg = Negative(Value=multiplication_2)
ln = Line(StartPoint=item.Item, EndPoint=item.Item1)
rotate = Rotate(Geometry=ln, Angle=degrees(neg), Plane=xz)  # -> Geometry, Transform
rec_2 = DataRecorder(rotate.Geometry, DataLimit=-10, RecordData=True)
end = EndPoints(Curve=rotate.Geometry)  # -> Start, End
vdisex = VectorDisplayEx(Point=end.Start, Vector=rotate.Geometry, Colour=ColourSwatch(SwatchColor=RGB(255, 0, 0)), Width=4)
